# Dynamo graph Home.dyn (Dynamo 1.3.3.4111)

directory_path = Directory("D:\test")
string = StringInput("test_output.json")
fileAdapter = CreateAdapterComponent(directory_path, string)
pullType = CreateEnumComponent()
boolean = BoolSelector(true)
pull = PullComponent(fileAdapter, arg2=pullType, arg4=boolean)
explode = ExplodeComponent(pull)
watch = Watch(explode)
family_types = FamilyTypes("Bar Chair:Bar Chair")
byPoint = FamilyInstance.ByPoint(familyType=family_types, point=explode)
geometry = Element.Geometry(byPoint)
