# Grasshopper definition Sprinkler Placement.gh (Grasshopper 1.0.5)
# plug-ins: BH.UI.Grasshopper

optimization_lvl = Slider(1, range=1..10)
max_d = Panel("4")
panel = Panel("""m

Most Econ X Dist: """)
panel_2 = Panel("""m
Most Econ Y Dist: """)
panel_3 = Panel("""m²
Max Distance: """)
panel_4 = Panel("""Rules:
Max Area: """)
boolean_toggle = BooleanToggle(True)
# Level Filter
panel_5 = Panel("2")
Y = UnitY(Factor=expr("-x", 1))

# ----
# Del Invalid Bhom Obj
cluster = Cluster_2(data=boolean_toggle)  # -> adapter, B, L
cluster_2 = Cluster(adapter=cluster.adapter, x=panel_5, active=boolean_toggle)  # -> name, L
revit_pulled_parameters = Panel(cluster.B)
panel_6 = Panel(cluster_2.name)
panel_7 = Panel(cluster_2.L)
valid_bhom_spaces = Data(cluster.L)

pushtype = PushType(
    {"FullPush": 0, "CreateOnly": 1, "CreateNonExisting": 2, "UpdateOnly": 3, "DeleteThenCreate": 4, "AdapterDefault": 5}, selected="DeleteThenCreate",
    Component="BH.oM.Adapter.PushType",
    Selection=4)
fileadapter = FileAdapter(Folder="D:\test", FileName="test_output.json", Component="{ ..ctor")
explode = Explode(Object=valid_bhom_spaces, Component="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")  # -> Zones, LightingGain, EquipmentGain, PeopleGain, Infiltration, Ventilation, Exhaust, OccupantDensity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

# ---- group: Filter Perimeters on Certain Level
# Filter Perimeters on Selected Level
# Revit to Ghop
item = ListItem(List=explode.Fragments, Index=-1, Wrap=True)  # -> flatten(Item)
perimter = Data(explode.Perimeter)
explode_2 = Explode(Object=item, Component="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")  # -> Parameters, BHoM_Guid, Name, Fragments, Tags, CustomData
explode_3 = Explode(Object=explode_2.Parameters, Component="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")  # -> Name, Value
branch = TreeBranch(Tree=explode_3.Name, Path="{0;0}", MaintainPaths=True)
mindex = MemberIndex(Set=branch, Member="Level")  # -> Index, Count
item_2 = ListItem(List=explode_3.Value, Index=mindex.Index, Wrap=True)  # -> flatten(Item)
equals = Equality(FirstNumber=item_2, SecondNumber=panel_7)  # -> Equality, Inequality
cull = CullPattern(List=perimter, CullPattern=equals.Equality)
disc = Discontinuity(Curve=cull, Level=1)  # -> Points, Parameters
pline = PolyLine(Vertices=disc.Points, Closed=True)  # -> flatten(Polyline)

# ----
Y_2 = UnitY(Factor=1)

series = Series(Start=0, Step=1, Count=35)  # -> graft(Series)

filtered_perimters = Data(pline)
item_3 = ListItem(List=filtered_perimters, Index=Slider(18, range=0..34), Wrap=True)
# Rectangular Rooms
number_slider = Slider(0.95, range=0.8..1)
area = Area(Geometry=item_3)  # -> Area, Centroid

max_area = Data("12")
hori = Slider(1.6, range=0..4)
vert = Slider(1, range=0..4)
crv = Curve(<curve referenced from the Rhino model>)
flip = FlipCurve(Curve=crv, Guide=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)  # -> Curve, Flag

expression = Expression(x=max_area, y=max_d, Expression="x/y")
dom = ConstructDomain(DomainStart=expression, DomainEnd=max_d)
range = Range(Domain=dom, Steps=optimization_lvl)
expression_2 = Expression(x=range, Expression="int(10*x)/10")

panel_8 = Panel(expression_2)
X = Data(panel_8)
expression_3 = Expression(x=max_area, y=X, Expression="x/y")
division = Division(A=X, B=2)
expression_4 = Expression(x=expression_3, Expression="floor(10*x)/10")
offset = OffsetCurve(Curve=flip.Curve, Distance=division, Plane=PlaneXY(0, 0, 0), Corners=1)
bbox = BoundingBox(Content=offset, Plane=PlaneXY(0, 0, 0))  # -> Box, Box_2
Y_3 = Data(expression_4)
debox = DeconstructBox(Box=bbox.Box)  # -> Plane, X, Y, Z
dedomain = DeconstructDomain(Domain=debox.X)  # -> Start, End
dedomain_2 = DeconstructDomain(Domain=debox.Y)  # -> Start, End
pt = ConstructPoint(XCoordinate=dedomain.Start, YCoordinate=dedomain_2.Start, ZCoordinate=debox.Z)
pt_2 = ConstructPoint(XCoordinate=dedomain.End, YCoordinate=dedomain_2.Start, ZCoordinate=debox.Z)
pt_3 = ConstructPoint(XCoordinate=dedomain.Start, YCoordinate=dedomain_2.End, ZCoordinate=debox.Z)
subtraction = Subtraction(A=dedomain_2.End, B=dedomain_2.Start)
subtraction_2 = Subtraction(A=dedomain.End, B=dedomain.Start)
pt_x_max = Data(pt_2)
pt_y_max = Data(pt_3)
pt_o = Data(pt)
expression_5 = Expression(x=flatten(subtraction_2), y=X, Expression="floor(x/y)+1")
expression_6 = Expression(x=flatten(subtraction), y=Y_3, Expression="floor(x/y)+1")
ln = Line(StartPoint=pt_o, EndPoint=pt_x_max)
ln_2 = Line(StartPoint=pt_o, EndPoint=pt_y_max)
series_2 = Series(Start=0, Step=X, Count=expression_5)
series_3 = Series(Start=0, Step=Y_3, Count=expression_6)
addition = Addition(A=series_2, B=vert)
addition_2 = Addition(A=series_3, B=hori)
Y_4 = UnitY(Factor=addition_2)  # -> simplify(UnitVector)
X_2 = UnitX(Factor=addition)  # -> simplify(UnitVector)
lng = ListLength(List=X)
series_4 = Series(Start=0, Step=1, Count=lng)

panel_9 = Panel(series_3)

# ---- group: Gridlines
move = Move(Geometry=simplify(ln_2), Motion=X_2)  # -> Geometry, Transform
move_2 = Move(Geometry=simplify(ln), Motion=Y_4)  # -> Geometry, Transform

# ----
crossref = CrossReference(ListA=move_2.Geometry, ListB=move.Geometry, CrossMode=1)  # -> ListA, ListB
clx = CurveLine(Curve=flip.Curve, Line=move_2.Geometry)  # -> Points, Params, Count
clx_2 = CurveLine(Curve=flip.Curve, Line=move.Geometry)  # -> Points, Params, Count
llx = LineLine(Line1=crossref.ListA, Line2=crossref.ListB)  # -> ParamA, ParamB, PointA, PointB
trim = TrimTree(Tree=clx_2.Points, Depth=1)  # -> simplify(Tree)
trim_2 = TrimTree(Tree=clx.Points, Depth=1)  # -> simplify(Tree)
incurve = PointInCurve(Point=llx.PointA, Curve=flip.Curve)  # -> Relationship, Point
cull_2 = CullPattern(List=llx.PointA, CullPattern=incurve.Relationship)
intersections_in_boundary = Data(cull_2)
cp = ClosestPoint(Point=graft(trim), Cloud=intersections_in_boundary)  # -> ClosestPoint, CPIndex, Distance
cp_2 = ClosestPoint(Point=graft(trim_2), Cloud=intersections_in_boundary)  # -> ClosestPoint, CPIndex, Distance

trim_3 = TrimTree(Tree=cp.ClosestPoint, Depth=1)
trim_4 = TrimTree(Tree=cp_2.ClosestPoint, Depth=1)

dist = Distance(PointA=trim_3, PointB=trim)
dist_2 = Distance(PointA=trim_4, PointB=trim_2)
larger = LargerThan(FirstNumber=dist, SecondNumber=division)  # -> LargerThan, OrEqualTo
larger_2 = LargerThan(FirstNumber=dist_2, SecondNumber=division)  # -> LargerThan, OrEqualTo
cull_3 = CullPattern(List=trim, CullPattern=larger.LargerThan)
cull_4 = CullPattern(List=trim_2, CullPattern=larger_2.LargerThan)
hor_add_pts = Data(cull_4)
vert_add_pts = Data(cull_3)

# ---- group: Draw Gridlines
bbox_2 = BoundingBox(Content=item_3, Plane=PlaneXY(0, 0, 0))  # -> Box, Box_2

# ----
area_2 = Area(Geometry=bbox_2.Box)  # -> Area, Centroid
division_2 = Division(A=area.Area, B=area_2.Area)
smaller = SmallerThan(FirstNumber=division_2, SecondNumber=number_slider)  # -> SmallerThan, OrEqualTo
cull_5 = CullPattern(List=item_3, CullPattern=smaller.SmallerThan)

# ---- group: Cull additional points that are too close
cp_3 = ClosestPoint(Point=simplify(graft(hor_add_pts)), Cloud=vert_add_pts)  # -> ClosestPoint, CPIndex, Distance

# ----
trim_5 = TrimTree(Tree=cp_3.ClosestPoint, Depth=1)

# ---- group: Cull additional points that are too close (continued)
dist_3 = Distance(PointA=hor_add_pts, PointB=trim_5)
larger_3 = LargerThan(FirstNumber=dist_3, SecondNumber=Slider(1.5, range=0..2))  # -> LargerThan, OrEqualTo
python = GhPythonScript(x=larger_3.LargerThan)  # -> out, a; inputs x: Boolean
# ---------- python: Python ----------
__author__ = "u3514"
__version__ = "2020.07.30"

import rhinoscriptsyntax as rs

a=1
if x==0:
    a=x
# ---------- end python ----------
cull_6 = CullPattern(List=hor_add_pts, CullPattern=python.a)

# ----
hor_add_pts_culled = Data(cull_6)
merge = Merge(Data1=simplify(intersections_in_boundary), Data2=simplify(hor_add_pts_culled), Data3=simplify(vert_add_pts))
lng_2 = ListLength(List=merge)  # -> flatten(Length)
sort = SortList(Keys=lng_2, ValuesA=series_4)  # -> Keys, ValuesA
item_4 = ListItem(List=sort.ValuesA, Index=0, Wrap=True)
branch_2 = TreeBranch(Tree=merge, Path=item_4, MaintainPaths=True)

item_5 = ListItem(List=expression_2, Index=item_4, Wrap=True)
item_6 = ListItem(List=Y_3, Index=item_4, Wrap=True)
concat = Concatenate(
    FragmentA=panel_4,
    FragmentB="12",
    FragmentC=panel_3,
    FragmentD=max_d,
    FragmentE=panel,
    FragmentF=item_5,
    FragmentG=panel_2,
    FragmentH=item_6,
    FragmentI="m")
panel_10 = Panel(concat)
item_7 = ListItem(List=flatten(pt_o), Index=item_4, Wrap=True)
move_3 = Move(Geometry=item_7, Motion=Y)  # -> Geometry, Transform
tag = TextTag3D(Location=move_3.Geometry, Text=panel_10, Size="2", Colour=ColourSwatch(SwatchColor=RGB(255, 255, 255)), Justification=7)
concat_2 = Concatenate(FragmentA="{", FragmentB=item_4, FragmentC=";?}")
split = SplitTree(Data=clx.Points, Masks=flatten(concat_2))  # -> Positive, Negative
panel_11 = Panel(concat_2)
item_8 = ListItem(List=split.Positive, Index=0, Wrap=True)
clean = CleanTree(RemoveNulls=True, RemoveInvalid=True, RemoveEmpty=True, Tree=item_8)  # -> flatten(Tree)
lng_3 = ListLength(List=clean)
move_4 = Move(Geometry=item_7, Motion=Y_2)  # -> Geometry, Transform
split_2 = SplitList(List=clean, Index=expr("x-1", lng_3))  # -> ListA, ListB
shift = ShiftList(List=clean, Shift=1, Wrap=False)
ln_3 = Line(StartPoint=item_7, EndPoint=move_4.Geometry)
lineardim = LinearDimension(Line=ln_3, PointA=split_2.ListA, PointB=shift, Text="{0:0.0}", Size=1)
data = Data(branch_2)
points = Data(data)
pdecon = Deconstruct(Point=points)  # -> XComponent, YComponent, ZComponent
point = Point(X=pdecon.XComponent, Y=pdecon.YComponent, Z=pdecon.ZComponent, Component="BH.oM.Geometry.Point")
createcustom = CreateCustom(Variable=point, Component="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")
push = Push(Adapter=fileadapter, Objects=flatten(createcustom), PushType=pushtype, Active=Toggle(True), Component="{ .Push")  # -> Objects, Success
panel_12 = Panel(push.Success)

# ---- group: Draw Gridlines (continued)
cull_7 = CullPattern(List=bbox_2.Box, CullPattern=invert(smaller.SmallerThan))
debox_2 = DeconstructBox(Box=cull_7)  # -> Plane, X, Y, Z
dedomain_3 = DeconstructDomain(Domain=debox_2.X)  # -> Start, End
dedomain_4 = DeconstructDomain(Domain=debox_2.Y)  # -> Start, End
subtraction_3 = Subtraction(A=dedomain_3.End, B=dedomain_3.Start)
subtraction_4 = Subtraction(A=dedomain_4.End, B=dedomain_4.Start)
dist_x = Data(subtraction_3)
dist_x_2 = Data(subtraction_4)
expression_7 = Expression(x=dist_x_2, y=Y_3, Expression="floor(x/y)+1")
expression_8 = Expression(x=dist_x, y=X, Expression="floor(x/y)+1")
y_number = Integer(expression_7)
x_number = Integer(expression_8)
dedomain_5 = DeconstructDomain(Domain=debox_2.Z)  # -> Start, End
dedomain_6 = DeconstructDomain(Domain=debox_2.Z)  # -> Start, End
dedomain_7 = DeconstructDomain(Domain=debox_2.Z)  # -> Start, End
dedomain_8 = DeconstructDomain(Domain=debox_2.Z)  # -> Start, End
expression_9 = Expression(l=dist_x, n=x_number, d=X, Expression="(l-(n-1)*d)/2")
expression_10 = Expression(l=dist_x_2, n=y_number, d=Y_3, Expression="(l-(n-1)*d)/2")
pt_4 = ConstructPoint(XCoordinate=dedomain_3.Start, YCoordinate=dedomain_4.Start, ZCoordinate=dedomain_5.Start)
pt_5 = ConstructPoint(XCoordinate=dedomain_3.Start, YCoordinate=dedomain_4.Start, ZCoordinate=dedomain_6.Start)
pt_6 = ConstructPoint(XCoordinate=dedomain_3.End, YCoordinate=dedomain_4.Start, ZCoordinate=dedomain_7.Start)
pt_7 = ConstructPoint(XCoordinate=dedomain_3.Start, YCoordinate=dedomain_4.End, ZCoordinate=dedomain_8.Start)
ln_4 = Line(StartPoint=pt_4, EndPoint=pt_6)
ln_5 = Line(StartPoint=pt_5, EndPoint=pt_7)
d0_x = Data(expression_9)
d0_y = Data(expression_10)
horizontal_gridline_0 = Data(ln_4)
horizontal_gridline_0_2 = Data(ln_5)
series_5 = Series(Start=d0_x, Step=X, Count=x_number)
series_6 = Series(Start=d0_y, Step=Y_3, Count=y_number)
coords_x = Data(series_5)
coords_y = Data(series_6)
Y_5 = UnitY(Factor=coords_y)
X_3 = UnitX(Factor=coords_x)
move_5 = Move(Geometry=horizontal_gridline_0, Motion=Y_5)  # -> Geometry, Transform
move_6 = Move(Geometry=horizontal_gridline_0_2, Motion=X_3)  # -> Geometry, Transform
horizontal_gridlines = Data(move_5.Geometry)
horizontal_gridlines_2 = Data(move_6.Geometry)
merge_2 = Merge(Data1=horizontal_gridlines_2, Data2=horizontal_gridlines)
gridlines = Data(merge_2)

# ----
crossref_2 = CrossReference(ListA=horizontal_gridlines_2, ListB=horizontal_gridlines, CrossMode=1)  # -> ListA, ListB
ccx = CurveCurve(CurveA=crossref_2.ListA, CurveB=crossref_2.ListB)  # -> flatten(Points), ParamsA, ParamsB

# ---- group: Draw Gridlines (continued)
intersections = Data(ccx.Points)

# ==== cluster Cluster
createtype = CreateType(Component="BH.oM.Geometry.SettingOut.Level")
adapter = ClusterInput()
active = ClusterInput()
filterrequest = FilterRequest(Type=createtype, Component="{ .FilterRequest")
pull = Pull(
    Adapter=adapter,
    Request=filterrequest,
    PullType="{ \"_t\" : \"System.Enum\", \"TypeName\" : { \"_t\" : \"System.Type\", \"Name\" : \"BH.oM.Adapter.PullType\" }, \"Value\" : \"AdapterDefault\" }",
    Active=active,
    Component="{ .Pull")
explode = Explode(Object=pull, Component="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")  # -> Name, Elevation, BHoM_Guid, Fragments, Tags, CustomData
x = ClusterInput()
contains = GhPythonScript(y=explode.Name, x=x)  # -> flatten(Bool)
# ---------- contains: Python ----------
__author__ = "u3514"
__version__ = "2020.07.29"

import rhinoscriptsyntax as rs

print(x in y)
# ---------- end contains ----------
list_item = ListItem(List=explode.Fragments, Index=0, Wrap=True)
name = ClusterOutput(explode.Name)
explode_2 = Explode(Object=list_item, Component="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")  # -> UniqueId, flatten(ElementId), CategoryName, FamilyName, FamilyTypeName, FamilyTypeId
panel = Panel(explode_2.ElementId)
cull = CullPattern(List=panel, CullPattern=contains)
L = ClusterOutput(cull)

# ==== cluster Cluster_2
data = ClusterInput()
data_2 = Data(data)
revitadapter = RevitAdapter(Active=data_2, Component="{ ..ctor")
createtype = CreateType(Component="BH.oM.Environment.Elements.Space")
adapter = ClusterOutput(revitadapter)
filterrequest = FilterRequest(Type=createtype, Component="{ .FilterRequest")
pull = Pull(
    Adapter=revitadapter,
    Request=filterrequest,
    PullType="{ \"_t\" : \"System.Enum\", \"TypeName\" : { \"_t\" : \"System.Type\", \"Name\" : \"BH.oM.Adapter.PullType\" }, \"Value\" : \"AdapterDefault\" }",
    Active=data_2,
    Component="{ .Pull")
explode = Explode(Object=pull, Component="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")  # -> Zones, LightingGain, EquipmentGain, PeopleGain, Infiltration, Ventilation, Exhaust, OccupantDensity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
_4th_rvt_pll_para = ListItem(List=explode.Fragments, Index=4, Wrap=True)  # -> flatten(Item)
explode_2 = Explode(Object=_4th_rvt_pll_para, Component="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")  # -> Parameters, BHoM_Guid, Name, Fragments, Tags, CustomData
explode_3 = Explode(Object=explode_2.Parameters, Component="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")  # -> Name, Value
branch = TreeBranch(Tree=explode_3.Name, Path="{0;0}", MaintainPaths=True)
mindex = MemberIndex(Set=branch, Member="Level")  # -> Index, Count
B = ClusterOutput(branch)
level = ListItem(List=explode_3.Value, Index=mindex.Index, Wrap=True)  # -> flatten(Item)
cull = CullPattern(List=pull, CullPattern=level)
L = ClusterOutput(cull)
